# Grasshopper definition solar-radiation.gh (Grasshopper 0.9.76)
# plug-ins: DIVA Daylight

filename = Filename("CityMatrix/city-heights.txt")
c_script = CSharpScript(filename=filename)  # -> out, heights, widths, width, length; inputs filename: String
# ---------- c_script: C# ----------
    filename = Environment.GetFolderPath(Environment.SpecialFolder.MyDocuments) + "/" + filename;
    StreamReader input = new StreamReader(filename);
    length = GetFileLength(filename);
    width = GetFileWidth(filename);
    float[,] outputHeights = new float[(int) width, (int) length];
    float[,] outputWidths = new float[(int) width, (int) length];
    int j = 0;
    while(!input.EndOfStream)
    {
      string[] line = input.ReadLine().Split(',');
      for(int i = 0; i < line.Length; i++) {
        string[] entry = line[i].Split('-');
        outputWidths[i, j] = float.Parse(entry[0]);
        outputHeights[i, j] = float.Parse(entry[1]);
      }
      j++;
    }
    heights = outputHeights;
    widths = outputWidths;
    input.Close();
# ---------- c_script: C# additional code ----------
  int GetFileLength(string path) {
    StreamReader input = new StreamReader(path);
    int i = 0;
    while(!input.EndOfStream) {
      input.ReadLine();
      i++;
    }
    input.Close();
    return i;
  }

  int GetFileWidth(string path) {
    StreamReader input = new StreamReader(path);
    int output = input.ReadLine().Split(',').Length;
    input.Close();
    return output;
  }

  /// <summary>
  /// This method will be called once every solution, before any calls to RunScript.
  /// </summary>
  public override void BeforeRunScript()
  { }
  /// <summary>
  /// This method will be called once every solution, after any calls to RunScript.
  /// </summary>
  public override void AfterRunScript()
  { }
# ---------- end c_script ----------
c_script_2 = CSharpScript(width=c_script.width, length=c_script.length, widths=c_script.widths)  # -> xVals, yVals; inputs width: Int32, length: Int32, widths: list of Double
# ---------- c_script_2: C# ----------
    double[] xSet = new double[width * length];
    double[] ySet = new double[width * length];

    for(int i = 0; i < width; i++) {
      for(int j = 0; j < length; j++) {
        xSet[(i * length + j)] = widths[i * length + j] * i;
        ySet[i * length + j] = widths[i * length + j] * (length - j - 1);
      }
    }
    xVals = xSet;
    yVals = ySet;
# ---------- end c_script_2 ----------
c_script_3 = CSharpScript(heights=c_script.heights, widths=c_script.widths, width=c_script.width, length=c_script.length, verticalOffset=0.5)  # -> X, Y, Z; inputs heights: list of Int32, widths: list of Double, width: Int32, length: Int32, verticalOffset: Double
# ---------- c_script_3: C# ----------
    double[] xSet = new double[49 * width * length];
    double[] ySet = new double[49 * width * length];
    double[] zSet = new double[49 * width * length];
    double maxWidth = widths.Max();
    float iOffset = 0f;
    for(int i = 0; i < width; i++) {
      float jOffset = 0f;
      for(int j = 0; j < length; j++) {
        float curWidth = (float) widths[i * length + j];
        float kOffset = 0f;
        for(int k = 0; k < 7; k++) {
          float lOffset = 0f;
          for(int l = 0; l < 7; l++) {
            int index = (i * length * 49) + (j * 49) + (k * 7) + l;
            xSet[index] = iOffset + kOffset + 0.5f * curWidth / 7;
            ySet[index] = length * maxWidth - (jOffset + lOffset + 0.5f * curWidth / 7);
            zSet[index] = heights[i * length + j] + verticalOffset;
            lOffset += (float) widths[length * i + j] / 7;
          }
          kOffset += (float) widths[length * i + j] / 7;
        }
        jOffset += (float) widths[length * i + j];
      }
      iOffset += (float) widths[length * i];
    }
    X = xSet;
    Y = ySet;
    Z = zSet;
# ---------- end c_script_3 ----------
addition = Addition(A=c_script_2.xVals, B=c_script.widths)
addition_2 = Addition(A=c_script_2.yVals, B=c_script.widths)
pt = ConstructPoint(XCoordinate=c_script_3.X, YCoordinate=c_script_3.Y, ZCoordinate=c_script_3.Z)
pt_2 = ConstructPoint(XCoordinate=c_script_2.xVals, YCoordinate=c_script_2.yVals, ZCoordinate=0)
pt_3 = ConstructPoint(XCoordinate=addition, YCoordinate=addition_2, ZCoordinate=c_script.heights)
xy = XYPlane(Origin=Point(0, 0, 0))
box = Box2Pt(PointA=pt_2, PointB=pt_3, Plane=xy)
brep = Brep(box)
sensor = Sensor(
    Point=pt,
    Vector=Vector(0, 0, 1),
    BooleanValue_0=False,
    BooleanValue_1=False,
    Hidden_0=False,
    Hidden_1=False,
    IntegerValue_0=-2147483648,
    IntegerValue_1=-2147483648,
    IntervalMax_0=-1.797693135e+308,
    IntervalMax_1=-1.797693135e+308,
    IntervalMin_0=-1.797693135e+308,
    IntervalMin_1=-1.797693135e+308,
    Name_0="Point",
    Name_1="Vector",
    NumberValue_0=-1.797693135e+308,
    NumberValue_1=-1.797693135e+308)
grid = DaylightingGrid(
    Sensors=sensor,
    BooleanValue_0=False,
    BooleanValue_1=False,
    BooleanValue_10=False,
    BooleanValue_11=False,
    BooleanValue_12=False,
    BooleanValue_13=False,
    BooleanValue_14=False,
    BooleanValue_15=False,
    BooleanValue_16=False,
    BooleanValue_17=False,
    BooleanValue_18=False,
    BooleanValue_19=False,
    BooleanValue_2=False,
    BooleanValue_20=False,
    BooleanValue_21=False,
    BooleanValue_22=False,
    BooleanValue_3=False,
    BooleanValue_4=False,
    BooleanValue_5=False,
    BooleanValue_6=False,
    BooleanValue_7=False,
    BooleanValue_8=False,
    BooleanValue_9=False,
    Hidden_0=True,
    Hidden_1=True,
    Hidden_10=True,
    Hidden_11=True,
    Hidden_12=True,
    Hidden_13=True,
    Hidden_14=True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)
obj = SceneObject(
    Geometry=brep,
    BooleanValue_0=False,
    BooleanValue_1=False,
    Hidden_0=False,
    Hidden_1=False,
    IntegerValue_0=-2147483648,
    IntegerValue_1=-2147483648,
    IntervalMax_0=-1.797693135e+308,
    IntervalMax_1=-1.797693135e+308,
    IntervalMin_0=-1.797693135e+308,
    IntervalMin_1=-1.797693135e+308,
    Name_0="Geometry",
    Name_1="Material",
    NumberValue_0=-1.797693135e+308,
    NumberValue_1=-1.797693135e+308,
    OutputHidden_0=False,
    OutputName_0="Scene Object",
    TextValuePersistent_1="OutsideGround_10",
    TextValueVolatile_1="OutsideGround_10")
rad_map = RadiationMap(
    Name="CityMatrix",
    Grids=grid,
    Objects=obj,
    Run=Toggle(True),
    BooleanValue_0=False,
    BooleanValue_1=False,
    BooleanValue_10=False,
    BooleanValue_11=False,
    BooleanValue_12=False,
    BooleanValue_13=False,
    BooleanValue_14=False,
    BooleanValue_15=True,
    BooleanValue_2=False,
    BooleanValue_3=False,
    BooleanValue_4=False,
    BooleanValue_5=False,
    BooleanValue_6=False,
    BooleanValue_7=False,
    BooleanValue_8=False,
    BooleanValue_9=False,
    Hidden_0=False,
    Hidden_1=False,
    Hidden_10=True,
    Hidden_11=True,
    Hidden_12=True,
    Hidden_13=True,
    Hidden_14=True,
    Hidden_15=False,
    Hidden_2=False,
    Hidden_3=True,
    Hidden_4=False,
    Hidden_5=True,
    Hidden_6=False,
    Hidden_7=True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)  # -> Out, SolarEnergy, EnergyDensity, Grid
grid_v = GridViewer(
    Grid=rad_map.Grid,
    active_element_0="Show Legend",
    active_element_1="Show Sensors",
    annual_metric=0,
    BooleanValue_0=False,
    BooleanValue_1=False,
    BooleanValue_10=False,
    BooleanValue_11=False,
    BooleanValue_12=False,
    BooleanValue_13=False,
    BooleanValue_14=False,
    BooleanValue_15=False,
    BooleanValue_16=False,
    BooleanValue_17=False,
    BooleanValue_2=False,
    BooleanValue_3=False,
    BooleanValue_4=False,
    BooleanValue_5=False,
    BooleanValue_6=False,
    BooleanValue_7=False,
    BooleanValue_8=False,
    BooleanValue_9=False,
    Hidden_0=False,
    Hidden_1=True,
    Hidden_10=True,
    Hidden_11=True,
    Hidden_12=True,
    Hidden_13=True,
    Hidden_14=True,
    Hidden_15=True,
    Hidden_16=True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)  # -> SensorPts, SensorData
panel = Panel(rad_map.Out)
c_script_4 = CSharpScript(filename="CityMatrix/sensor-data.txt", sensorData=grid_v.SensorData)  # inputs filename: String, sensorData: list of Double
# ---------- c_script_4: C# ----------
    filename = Environment.GetFolderPath(
      Environment.SpecialFolder.MyDocuments) + "/" + filename;
    List<string> output = sensorData.ConvertAll(x => x.ToString());
    System.IO.File.WriteAllLines(filename, output);
# ---------- end c_script_4 ----------
